% Simulink data dictionary Dictionary.sldd
% references Dictionary.sldd

Tests_Enum_SignalGenerator_TestType = enum(DefaultValue="StepThroughZero", AddClassNameToEnumNames=true)
  StepThroughZero = 1
  Step = 2
  Sine = 3
  Triangle = 4
  Pulse = 5
  UnitConst = 6

Tests_SignalGenerator_Parameters = Simulink.Bus()
  TestType: int8
  Amplitude: double
  PeriodTime: double
  NumOfPeriods: double
  Bias: double
  PulseWidth: double
  ConstValue: double

Tests_SpectrumAnalyzer_Parameters = Simulink.Bus()
  Amplitude: double
  Offset: double
  PhaseIn: double
  Min_PeriodsPerSine: double
  Min_PointsPerSine: double
  Start_Frequency: double
  Stop_Frequency: double
  LinearOrLog: int8
  Linear_Step_Frequency: double
  Logarithmic_NumOfPoints: double
  OLCL: int8

imageHeight = 720
imageWidth = 1280
Camera = Simulink.ConfigSet(StartTime="0", StopTime="10", FixedStep="ts_camera", Solver="FixedStepDiscrete", ProdHWDeviceType="Intel->x86-64 (Windows64)", SystemTargetFile="grt.tlc", TargetLang="C")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
InitalDroneXYZ = [7 80 6.9]
plant_N = 2
plant_Backlash = 5e-05
plant_Jload = 0.01
plant_Jmotor = 0.01
plant_Kk = 25
plant_Kv = 0.035

Processed_Sensors = Simulink.Bus()
  Current: double
  Gyro_Integral: double
  SE_Derivative: double

ts_camera = 0.016
ts_control = 0.0008
dt = 0.0008

Tests_Enum_SpectralTestSystem = enum(DefaultValue="NoSpectralTest", AddClassNameToEnumNames=true)
  NoSpectralTest = 0
  Current_Plant = 5
  Current_CL = 6
  SE_Velocity_Plant = 1
  SE_Velocity_CL = 2
  Gyro_Position_Plant = 3
  Gyro_Position_CL = 4

Control = Simulink.ConfigSet(StartTime="0", StopTime="10", FixedStep="ts_control", Solver="FixedStepDiscrete", ProdHWDeviceType="Intel->x86-64 (Windows64)", SystemTargetFile="grt.tlc", TargetLang="C")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
plant_Kt = 1
plant_Kb = 1
plant_R = 0.5
plant_L = 0.0025

ScopesSignals_Position = Simulink.Bus()
  Pos_LCmd: double
  Gyro_Integral: double
  Vel_LCmd: double

ScopeSignals = Simulink.Bus()
  Position: Bus: ScopesSignals_Position
  Velocity: Bus: ScopesSignals_Velocity
  Current: Bus: ScopesSignals_Current

ScopesSignals_Current = Simulink.Bus()
  Current_LCmd: double
  Current: double
  Voltage_LCmd: double
  SE_Derivative: double

ScopesSignals_Velocity = Simulink.Bus()
  Vel_LCmd: double
  SE_Derivative: double
  Current_LCmd: double

Motion_Manager = Simulink.Bus()
  Position_En: boolean
  Velocity_En: boolean
  Current_En: boolean
  Position_Command: double
  Velocity_Command: double
  Current_Command: double
  Voltage_Command: double
  NullifyFeedback: boolean

Controller_Mode = enum(DefaultValue="Current")
  Voltage = 0
  Current = 1
  Velocity = 2
  VelocityErrorInput = 3
  Position = 4

szEventMask = [144 256]
maxAngles = [0.1745329 0.1745329 0.1745329]
maxOmega = [0.1745329 0.1745329 0.1745329]